# Grasshopper definition ScaleValue.gh (Grasshopper 0.9.61)

txt = Text()
line = Line(Line((-288.1120121, -15570.55134, 0), (-241.1685141, -15570.55134, 0)))
scale = Integer(10)
len = Length(Curve=line)
division = Division(A=scale, B=len)
